# Grasshopper definition Floating_Point_OS.gh (Grasshopper 0.9.76)
# plug-ins: Heliotrope, Firefly.X, Firefly.Core

# ----
# Ajuste Horario:
armed = BooleanToggle(True)
timer = Timer(TimerInterval=20, Target=now)
now = JulianDayCurrentTime(ContinuousUpdate=armed)
panel = Panel(now)
jday = JDayAdd(JulianDay=now, AddDays=0, AddHours="-3", AddMinutes=0, AddSeconds=0)
panel_2 = Panel(jday)

# ----
# Pared: Dimensiones y Posición(cm)
# Distancia Pared-Espejos:
number_slider = Slider(44839.5, range=0..50000)
# Offset Derecha-Izquierda:
number_slider_2 = Slider(7646.6, range=-2500..20000)
# Offset Arriba-Abajo:
number_slider_3 = Slider(2412.9, range=-2500..10000)
# Ancho:
number_slider_4 = Slider(21294.4, range=0..30000)
# Alto:
# Altura Plano Sombras:
number_slider_5 = Slider(49652.6, range=0..60000)
# Posición Espejos
# Altura común espejos:
# (caballete)
number_slider_6 = Slider(934.5, range=0..1000)
# Offset Pared - Espejos:
number_slider_7 = Slider(0, range=0..1000)
# Horario de
# funcionamiento
fin = Slider(13, range=9..22)
inicio = Slider(19, range=9..22)
# Margen Seguridad:
number_slider_8 = Slider(0, range=-2500..2500)
norte = Slider(14, range=-30..30)
dif = Slider(1, range=0..2)
segments = Slider(21, range=3..24)
number_slider_9 = Slider(11, range=0..100)
# Color sombras:
offset_reflejo_a = Slider(511, range=0..10000)
offset_reflejo_b = Slider(398, range=0..10000)
offset_reflejo_c = Slider(313, range=0..10000)

# ----
# Diametro Espejo
# (cm)
# A
panel_3 = Panel("900")
division = Division(A=panel_3, B=2)

# ----
# Diametro Espejo
# (cm)
# B
panel_4 = Panel("600")
division_2 = Division(A=panel_4, B=2)

# ----
# Diametro Espejo
# (cm)
# C
panel_5 = Panel("450")
division_3 = Division(A=panel_5, B=2)

# ----
# Offset base heliostatos:
# Distancia entre Espejos:
number_slider_10 = Slider(-3958, range=-5000..5000)
# Latitud:
panel_6 = Panel("-33.440522")
# Longitud:
panel_7 = Panel("-70.646518")
compose = JDayCompose(
    Year="2015",
    Month=Slider(10, range=0..12),
    Day=Slider(15, range=0..30),
    Hour=Slider(10, range=0..24),
    Minute=Slider(473, range=0..800),
    Second=Slider(0, range=0..59),
    UTCOffset=0)

# ----
# Radios offset máquina
# rX:
# rY:
panel_8 = Panel("10,75")

col = Colour(RGBA(255, 255, 255, 99))
pt = ConstructPoint(XCoordinate=number_slider, YCoordinate=number_slider_2, ZCoordinate=number_slider_3)
panel_9 = Panel(compose)
pt_2 = ConstructPoint(XCoordinate=0, YCoordinate=0, ZCoordinate=number_slider_8)
addition = Addition(A=number_slider_6, B="29.3")
xy = XYPlane(Origin=pt_2)
yz = YZPlane(Origin=pt)

# ----
# Vector Norte
Z = UnitZ(Factor=1)
X = UnitX(Factor=1)
rev = Reverse(Vector=Z)
rad = Radians(Degrees=norte)
vrot = Rotate(Vector=X, Axis=rev, Angle=rad)
amp = Amplitude(Vector=vrot, Amplitude=50000)
xy_2 = XYPlane(Origin=Point(0, 0, 0))
vdis_n = VectorDisplay(Anchor=xy_2, Vector=amp)

planesrf = PlaneSurface(Plane=yz, XSize=number_slider_4, YSize=number_slider_5)
subtraction = Subtraction(A=number_slider_4, B=number_slider_10)
subtraction_2 = Subtraction(A=subtraction, B="1150")
canvas_borde = Curve(planesrf)
jday_2 = JDayParameter(port=panel)
panel_10 = Panel(jday_2)
subtraction_3 = Subtraction(A=subtraction_2, B="1150")
calc = SolarCalculator(JulianDay=jday_2, Latitude=panel_6, Longitude=panel_7, North=vrot)  # -> Azimuth, Elevation, SolarVector
# Origen Espejos
# A
pt_3 = ConstructPoint(XCoordinate=number_slider_7, YCoordinate=subtraction, ZCoordinate=addition)
# B
pt_4 = ConstructPoint(XCoordinate=number_slider_7, YCoordinate=subtraction_2, ZCoordinate=addition)
# C
pt_5 = ConstructPoint(XCoordinate=number_slider_7, YCoordinate=subtraction_3, ZCoordinate=addition)
# Vector Solar(VS)
amp_2 = Amplitude(Vector=calc.SolarVector, Amplitude=Slider(1000, range=0..1000))

# ----
# Limites Margen
addition_2 = Addition(A="400", B=division)
multiplication = Multiplication(A=addition_2, B=-1)
offset = Offset(Curve=canvas_borde, Distance=multiplication, Plane=yz, Corners=1)
explode = Explode(Curve=offset, Recursive=True)  # -> Segments, Vertices
item = ListItem(List=explode.Vertices, Index=2, Wrap=True)
item_2 = ListItem(List=explode.Vertices, Index=0, Wrap=True)
pdecon = Deconstruct(Point=item_2)  # -> XComponent, YComponent, ZComponent
pdecon_2 = Deconstruct(Point=item)  # -> XComponent, YComponent, ZComponent
dom = ConstructDomain(DomainStart=pdecon_2.YComponent, DomainEnd=pdecon.YComponent)
dom_2 = ConstructDomain(DomainStart=pdecon.ZComponent, DomainEnd=pdecon_2.ZComponent)

# ----
# Dibuja arco y sol
number_slider_11 = Slider(212004, range=0..1000000)
line = LineSDL(Start=pt_3, Direction=calc.SolarVector, Length=number_slider_11)
solar_arc = SolarArc(
    JulianDay=jday_2,
    Latitude=panel_6,
    Longitude=panel_7,
    North=vrot,
    Origin=pt_3,
    ScaleArc=number_slider_11,
    ScaleSun=1000,
    Offset=0.5)  # -> SolarArc, Sun, SolarVector, TimeOfDay
eval = EvaluateCurve(Curve=line, Parameter=1)  # -> Point, Tangent, Angle
sph = Sphere(Base=eval.Point, Radius=3000)
arc = CircularArc(solar_arc.SolarArc)

# ----
# Distancia a pared
num = Number(number_slider)

Z_2 = Slider(0.672, range=0..1)
Y = Slider(0.468, range=0..1)
Z_3 = Slider(0.577, range=0..1)
Z_4 = Slider(0.825, range=0..1)
Z_5 = Slider(0.825, range=0..1)
Y_2 = Slider(0.795, range=0..1)
Y_3 = Slider(0.879, range=0..1)
Y_4 = Slider(0.097, range=0..1)
Z_6 = Slider(0.887, range=0..1)
Y_5 = Slider(0.478, range=0..1)
Z_7 = Slider(0.578, range=0..1)
Y_6 = Slider(0.177, range=0..1)
Z_8 = Slider(0.692, range=0..1)
Z_9 = Slider(0.489, range=0..1)
Y_7 = Slider(0.512, range=0..1)
Y_8 = Slider(0.48, range=0..1)
Z_10 = Slider(0.789, range=0..1)
Y_9 = Slider(0.891, range=0..1)
Y_10 = Slider(0.638, range=0..1)
Z_11 = Slider(0.674, range=0..1)

# ----
# pt. 0
pt_6 = Pt(V_2=Y_3, T=dom, X=num, V=Z_4, T_2=dom_2)
pt_7 = Pt_2(V=Y_5, T=dom, X=num, V_2=Z_6, T_2=dom_2)
pt_8 = Pt_2(V=Y_4, T=dom, X=num, V_2=Z_5, T_2=dom_2)
pt_9 = Pt_2(V=Y, T=dom, X=num, V_2=Z_2, T_2=dom_2)
pt_10 = Pt_2(V=Y_6, T=dom, X=num, V_2=Z_7, T_2=dom_2)
pt_11 = Pt_2(V=Y_8, T=dom, X=num, V_2=Z_9, T_2=dom_2)
pt_12 = Pt_2(V=Y_2, T=dom, X=num, V_2=Z_3, T_2=dom_2)
pt_13 = Pt_2(V=Y_7, T=dom, X=num, V_2=Z_8, T_2=dom_2)
pt_14 = Pt_2(V=Y_9, T=dom, X=num, V_2=Z_11, T_2=dom_2)
pt_15 = Pt_2(V=Y_10, T=dom, X=num, V_2=Z_10, T_2=dom_2)

cat = Slider(13896, range=0..50000)
# pt. 1
bezier = Slider(23902, range=0..100000)
cat_2 = Slider(15195, range=0..100000)
# pt. 2
bezier_2 = Slider(25462, range=0..100000)
cat_3 = Slider(15845, range=0..100000)
# pt. 3
bezier_3 = Slider(19929, range=0..100000)
cat_4 = Slider(13506, range=0..100000)
# pt. 4
bezier_4 = Slider(17234, range=0..100000)
cat_5 = Slider(13636, range=0..100000)
# pt. 5
bezier_5 = Slider(17040, range=0..100000)
cat_6 = Slider(14063, range=0..100000)
# pt. 6
bezier_6 = Slider(15937, range=0..100000)
cat_7 = Slider(13972, range=0..100000)
# pt. 7
bezier_7 = Slider(14167, range=0..100000)
cat_8 = Slider(11924, range=0..100000)
# pt. 8
bezier_8 = Slider(15619, range=0..100000)
cat_9 = Slider(11908, range=0..50000)
# pt. 9
bezier_9 = Slider(15552, range=0..100000)
weave = Weave(Pattern=[0, 1], Stream0=cat, Stream1=bezier, NullGaps=False)
weave_2 = Weave(Pattern=[0, 1], Stream0=cat_2, Stream1=bezier_2, NullGaps=False)
weave_3 = Weave(Pattern=[0, 1], Stream0=cat_3, Stream1=bezier_3, NullGaps=False)
weave_4 = Weave(Pattern=[0, 1], Stream0=cat_4, Stream1=bezier_4, NullGaps=False)
weave_5 = Weave(Pattern=[0, 1], Stream0=cat_5, Stream1=bezier_5, NullGaps=False)
weave_6 = Weave(Pattern=[0, 1], Stream0=cat_6, Stream1=bezier_6, NullGaps=False)
weave_7 = Weave(Pattern=[0, 1], Stream0=cat_7, Stream1=bezier_7, NullGaps=False)
weave_8 = Weave(Pattern=[0, 1], Stream0=cat_8, Stream1=bezier_8, NullGaps=False)
weave_9 = Weave(Pattern=[0, 1], Stream0=cat_9, Stream1=bezier_9, NullGaps=False)
amp_3 = Amplitude(Vector=amp_2, Amplitude=Slider(100000, range=0..100000))

# ----
# Asigna cantidad de recorrido
# de acuerdo a la hora
expand = JDayExpand(JulianDay=jday_2, UTCOffset=0)  # -> Year, Month, Day, Hour, Minute, Second, String
remap = RemapNumbers(Value=expand.Second, Source=Domain(0, 59), Target=Domain(0, 1))  # -> Mapped, Clipped
addition_3 = Addition(A=expand.Minute, B=remap.Mapped)
remap_2 = RemapNumbers(Value=addition_3, Source=Domain(0, 60), Target=Domain(0, 1))  # -> Mapped, Clipped

weave_10 = Weave(
    Pattern=[0, 1, 2, 3, 4, 5, 6, 7, 8, 9],
    Stream0=pt_6,
    Stream1=pt_7,
    Stream2=pt_8,
    Stream3=pt_9,
    Stream4=pt_10,
    Stream5=pt_11,
    Stream6=pt_12,
    Stream7=pt_13,
    Stream8=pt_14,
    Stream9=pt_15,
    NullGaps=False)
merge = Merge(
    Data1=weave,
    Data2=weave_2,
    Data3=weave_3,
    Data4=weave_4,
    Data5=weave_5,
    Data6=weave_6,
    Data7=weave_7,
    Data8=weave_8,
    Data9=weave_9)

# ----
# Selecciona tramo de acuerdo a la hora
subtraction_4 = Subtraction(A=inicio, B=fin)
dom_3 = ConstructDomain(DomainStart=fin, DomainEnd=inicio)
dom_4 = ConstructDomain(DomainStart=0, DomainEnd=subtraction_4)
remap_3 = RemapNumbers(Value=expand.Hour, Source=dom_3, Target=dom_4)  # -> Mapped, Clipped

# ----
# Joysticks Read Serial
choose_joysticks_port = Slider(0, range=0..1)
ports_available = COMPortsAvailable()
read_joystick = BooleanToggle(False)
open_joystick_port = BooleanToggle(False)
panel_11 = Panel(ports_available)
item_3 = ListItem(List=panel_11, Index=choose_joysticks_port, Wrap=True)
panel_12 = Panel(item_3)
baud = Panel("115200")
timer_2 = Timer(TimerInterval=1, Target=read)
read = SerialReadGeneric(StartReadingValues=read_joystick, PortNumber=panel_12)  # -> SerialOutput, StatusMessage
open_joysticks_port = OpenClosePort(OpenClosePort=open_joystick_port, PortNumber=panel_12, BaudRate=baud)
panel_13 = Panel(read.StatusMessage)
panel_14 = Panel(open_joysticks_port)

# ----
# Genera arbol con
# sublistas para cada
# recorrido de una hora
# Selecciona una sublista
# y la divide para generar
# el tramo del recorrido
subset = SubList(
    List=weave_10,
    Domain=[Domain(0, 1), Domain(1, 2), Domain(2, 3), Domain(3, 4), Domain(4, 5), Domain(5, 6), Domain(6, 7), Domain(7, 8), Domain(8, 9)],
    Wrap=True)  # -> List, Index
simplify = SimplifyTree(Tree=subset.List, Front=False)
item_4 = TreeItem(Tree=simplify, Path=remap_3.Clipped, Index=0, Wrap=True)
item_5 = TreeItem(Tree=simplify, Path=remap_3.Clipped, Index=1, Wrap=True)
panel_15 = Panel(item_4)
panel_16 = Panel(item_5)

# ----
# Genera arbol con
# sublistas que contienen los valores de
# amplitudes de las diferentes secciones de
# la elipse para cada hora por separado.
subset_2 = SubList(
    List=merge,
    Domain=[Domain(0, 1), Domain(2, 3), Domain(4, 5), Domain(6, 7), Domain(8, 9), Domain(10, 11), Domain(12, 13), Domain(14, 15), Domain(16, 17)],
    Wrap=True)  # -> List, Index
simplify_2 = SimplifyTree(Tree=subset_2.List, Front=False)
item_6 = TreeItem(Tree=simplify_2, Path=remap_3.Clipped, Index=0, Wrap=True)
item_7 = TreeItem(Tree=simplify_2, Path=remap_3.Clipped, Index=1, Wrap=True)
panel_17 = Panel(item_6)
panel_18 = Panel(item_7)

split = TextSplit(Text=read.SerialOutput, Separators=",")
item_8 = ListItem(List=split, Index=[0, 1, 2, 3, 4, 5], Wrap=True)
panel_19 = Panel(item_8)
multiplication_2 = Multiplication(A="5", B=-1)
dom_5 = ConstructDomain(DomainStart="5", DomainEnd=multiplication_2)
dom_6 = ConstructDomain(DomainStart=0, DomainEnd=1024)
remap_4 = RemapNumbers(Value=panel_19, Source=dom_6, Target=dom_5)  # -> Mapped, Clipped
int = Integer(remap_4.Mapped)
reset = Panel("0")
factor_calibracion = Panel("10")
item_9 = ListItem(List=int, Index=0, Wrap=True)
item_10 = ListItem(List=int, Index=1, Wrap=True)
item_11 = ListItem(List=int, Index=2, Wrap=True)
item_12 = ListItem(List=int, Index=3, Wrap=True)
item_13 = ListItem(List=int, Index=4, Wrap=True)
item_14 = ListItem(List=int, Index=5, Wrap=True)
reset_2 = BooleanToggle(False)
dom_7 = ConstructDomain(DomainStart="999999999", DomainEnd="-999999999")
larger = LargerThan(FirstNumber=1, SecondNumber=item_9)  # -> LargerThan, OrEqualTo
larger_2 = LargerThan(FirstNumber=1, SecondNumber=item_10)  # -> LargerThan, OrEqualTo
larger_3 = LargerThan(FirstNumber=1, SecondNumber=item_11)  # -> LargerThan, OrEqualTo
larger_4 = LargerThan(FirstNumber=1, SecondNumber=item_12)  # -> LargerThan, OrEqualTo
larger_5 = LargerThan(FirstNumber=1, SecondNumber=item_13)  # -> LargerThan, OrEqualTo
larger_6 = LargerThan(FirstNumber=1, SecondNumber=item_14)  # -> LargerThan, OrEqualTo
multiplication_3 = Multiplication(A=factor_calibracion, B=item_9)
multiplication_4 = Multiplication(A=factor_calibracion, B=item_10)
multiplication_5 = Multiplication(A=factor_calibracion, B=item_11)
multiplication_6 = Multiplication(A=factor_calibracion, B=item_12)
multiplication_7 = Multiplication(A=factor_calibracion, B=item_13)
multiplication_8 = Multiplication(A=factor_calibracion, B=item_14)
timer_3 = Timer(TimerInterval=200, Target=[counter_6, counter_5, counter_4, counter_3, counter_2, counter])
counter = Counter(CountDirection=larger_6.LargerThan, Step=multiplication_8, StartStop=True, Reset=reset_2, OptionalCounterDomain=dom_7)
counter_2 = Counter(CountDirection=larger_5.LargerThan, Step=multiplication_7, StartStop=True, Reset=reset_2, OptionalCounterDomain=dom_7)
counter_3 = Counter(CountDirection=larger_4.LargerThan, Step=multiplication_6, StartStop=True, Reset=reset_2, OptionalCounterDomain=dom_7)
counter_4 = Counter(CountDirection=larger_3.LargerThan, Step=multiplication_5, StartStop=True, Reset=reset_2, OptionalCounterDomain=dom_7)
counter_5 = Counter(CountDirection=larger_2.LargerThan, Step=multiplication_4, StartStop=True, Reset=reset_2, OptionalCounterDomain=dom_7)
counter_6 = Counter(CountDirection=larger.LargerThan, Step=multiplication_3, StartStop=True, Reset=reset_2, OptionalCounterDomain=dom_7)
X_2 = Panel(counter_5)
Y_11 = Panel(counter_4)
Y_12 = Panel(counter_6)
X_3 = Panel(counter_3)
Y_13 = Panel(counter_2)
X_4 = Panel(counter)

# ----
# Genera trayectorias de elipses y posicion de los punteros
pt_16 = Point(panel_15)
pt_17 = Point(panel_16)

# ----
# Test distancia entre puntos
cull_i = CullIndex(List=subset.List, Indices=1, Wrap=True)
cull_i_2 = CullIndex(List=subset.List, Indices=0, Wrap=True)
panel_20 = Panel(cull_i)
panel_21 = Panel(cull_i_2)
dist = Distance(PointA=panel_20, PointB=panel_21)
panel_22 = Panel(dist)
smaller = SmallerThan(FirstNumber=panel_22, SecondNumber="400")  # -> SmallerThan, OrEqualTo
larger_7 = LargerThan(FirstNumber=panel_22, SecondNumber="700")  # -> LargerThan, OrEqualTo
flatten = FlattenTree(Tree=smaller.SmallerThan, Path="{0}")
flatten_2 = FlattenTree(Tree=larger_7.LargerThan, Path="{0}")
panel_23 = Panel(flatten)
panel_24 = Panel(flatten_2)

ln = Line(StartPoint=pt_16, EndPoint=pt_17)
eval_2 = EvaluateLength(Curve=ln, Length=Slider(0.5, range=0..1), Normalized=True)  # -> Point, Tangent, Parameter
X_5 = UnitX(Factor=1)
vec2pt = Vector2Pt(PointA=pt_16, PointB=eval_2.Point, Unitize=False)  # -> Vector, Length
pl = PlaneNormal(Origin=eval_2.Point, ZAxis=X_5)
deplane = DeconstructPlane(Plane=pl)  # -> Origin, XAxis, YAxis, ZAxis

# ----
# Muestra direccion de los recorridos
lng = ListLength(List=weave_10)
Z_12 = UnitZ(Factor=1)
vec2pt_2 = Vector2Pt(PointA=cull_i, PointB=cull_i_2, Unitize=False)  # -> Vector, Length
series = Series(Start=0, Step=1, Count=10)
amp_4 = Amplitude(Vector=Z_12, Amplitude=70)
move = Move(Geometry=weave_10, Motion=amp_4)  # -> Geometry, Transform
int_2 = Integer(series)
tag = TextTag(Location=move.Geometry, Text=int_2, Colour=RGB(161, 161, 161))
vdis = VectorDisplay(Anchor=cull_i, Vector=vec2pt_2.Vector)

rad_2 = Radians(Degrees="90")
vrot_2 = Rotate(Vector=vec2pt.Vector, Axis=deplane.ZAxis, Angle=rad_2)
cat_10 = Catenary(PointA=pt_16, PointB=pt_17, Length=panel_17, Gravity=vrot_2)
eval_3 = EvaluateCurve(Curve=cat_10, Parameter=Slider(72.773, range=0..200))  # -> Point, Tangent, Angle
eval_4 = EvaluateCurve(Curve=cat_10, Parameter=Slider(0, range=0..200))  # -> Point, Tangent, Angle
rev_2 = Reverse(Vector=eval_4.Tangent)
amp_5 = Amplitude(Vector=rev_2, Amplitude=panel_18)
amp_6 = Amplitude(Vector=eval_3.Tangent, Amplitude=panel_18)
panel_25 = Panel(remap_2.Mapped)
bzspan = BezierSpan(StartPoint=pt_16, StartTangent=amp_6, EndPoint=pt_17, EndTangent=amp_5)  # -> Curve, Length, Domain
len = Length(Curve=cat_10)
dom_8 = ConstructDomain(DomainStart=len, DomainEnd=1)
remap_5 = RemapNumbers(Value=panel_25, Source=Domain(0, 1), Target=dom_8)  # -> Mapped, Clipped
eval_5 = EvaluateLength(Curve=cat_10, Length=remap_5.Mapped, Normalized=False)  # -> Point, Tangent, Parameter

# ----
# Vector
# Reflejo(VR)
vec2pt_3 = Vector2Pt(PointA=pt_4, PointB=eval_5.Point, Unitize=False)  # -> Vector, Length

# ----
# Encuentra bisectriz entre
# VS y VR para normal
# Vector Normal
pl_2 = ConstructPlane(Origin=pt_4, XAxis=amp_2, YAxis=vec2pt_3.Vector)
angle = Angle(VectorA=amp_2, VectorB=vec2pt_3.Vector, Plane=pl_2)  # -> Angle, Reflex
deplane_2 = DeconstructPlane(Plane=pl_2)  # -> Origin, XAxis, YAxis, ZAxis
division_4 = Division(A=angle.Angle, B=2)
vrot_3 = Rotate(Vector=amp_2, Axis=deplane_2.ZAxis, Angle=division_4)

# ----
# Calcula "brazo" de X
X_6 = UnitX(Factor=50)
Z_13 = UnitZ(Factor=1)
X_7 = UnitX(Factor=1)
Y_14 = UnitY(Factor=1)
pl_3 = ConstructPlane(Origin=pl_2, XAxis=X_6, YAxis=Z_13)
pl_4 = ConstructPlane(Origin=pl_2, XAxis=X_7, YAxis=Y_14)
deplane_3 = DeconstructPlane(Plane=pl_3)  # -> Origin, XAxis, YAxis, ZAxis
pl_5 = ConstructPlane(Origin=pl_2, XAxis=vrot_3, YAxis=deplane_3.YAxis)
ppx = PlanePlane(PlaneA=pl_5, PlaneB=pl_4)
amp_7 = Amplitude(Vector=ppx, Amplitude="4")
pl_6 = PlaneNormal(Origin=deplane_2.Origin, ZAxis=amp_7)
move_2 = Move(Geometry=pl_6, Motion=amp_7)  # -> Geometry, Transform
ln_2 = Line(StartPoint=pl_2, EndPoint=move_2.Geometry)

# ----
# Calcula "brazo" de Y
amp_8 = Amplitude(Vector=vrot_3, Amplitude=panel_8)
pl_7 = PlaneNormal(Origin=move_2.Geometry, ZAxis=vrot_3)
move_3 = Move(Geometry=pl_7, Motion=amp_8)  # -> Geometry, Transform
ln_3 = Line(StartPoint=move_2.Geometry, EndPoint=move_3.Geometry)
# dibuja espejo
cir = Circle(Plane=move_3.Geometry, Radius=division_2)
refl = Reflector(Surface=cir, Point=move_3.Geometry, Vector=amp_2)
amp_9 = Amplitude(Vector=refl, Amplitude=-3000)

# ----
# Calcula Ángulo Azimuth
# Ángulo Azimuth
Z_14 = UnitZ(Factor=1)
rev_3 = Reverse(Vector=Z_14)
pl_8 = PlaneNormal(Origin=deplane_2.Origin, ZAxis=rev_3)
Y_15 = UnitY(Factor=1)
angle_2 = Angle(VectorA=Y_15, VectorB=ln_2, Plane=pl_8)  # -> Angle, Reflex
line_2 = LineSDL(Start=pl_8, Direction=Y_15, Length=number_slider_9)
rad_3 = Radians(Degrees=90)
arc_2 = Arc(Plane=pl_8, Radius=number_slider_9, Angle=angle_2.Angle)  # -> Arc, Length
rotate = Rotate(Geometry=arc_2.Arc, Angle=rad_3, Plane=pl_8)  # -> Geometry, Transform
deg = Degrees(Radians=angle_2.Angle)
arcdim = ArcDimension(Arc=rotate.Geometry, Offset=2, Text="{0:0.0}°", Size=1)

# ----
# Calcula Ángulo Altitud
# Ángulo Altitud
deplane_4 = DeconstructPlane(Plane=move_2.Geometry)  # -> Origin, XAxis, YAxis, ZAxis
deplane_5 = DeconstructPlane(Plane=pl_7)  # -> Origin, XAxis, YAxis, ZAxis
pl_9 = ConstructPlane(Origin=move_2.Geometry, XAxis=deplane_4.ZAxis, YAxis=deplane_5.ZAxis)
line_3 = LineSDL(Start=move_2.Geometry, Direction=ln_2, Length=number_slider_9)
angle_3 = Angle(VectorA=amp_7, VectorB=deplane_5.ZAxis, Plane=pl_9)  # -> Angle, Reflex
arc_3 = Arc(Plane=pl_9, Radius=number_slider_9, Angle=angle_3.Angle)  # -> Arc, Length
deg_2 = Degrees(Radians=angle_3.Angle)
arcdim_2 = ArcDimension(Arc=arc_3.Arc, Offset=2, Text="{0:0.0}°", Size=1)

# ----
# Dibuja reflejo en pared
line_4 = LineSDL(Start=move_3.Geometry, Direction=amp_9, Length=5000)
plx = LinePlane(Line=line_4, Plane=yz)  # -> Point, ParamL, ParamP
cast = CastSilhouette(BRep=cir, SolarVector=amp_9, Plane=yz)  # -> Projection, Silhouette, Front
ln_4 = Line(StartPoint=move_3.Geometry, EndPoint=plx.Point)
crv = Curve(cast.Silhouette)

# ----
# Proyecta sombra espejo
cast_2 = CastSilhouette(BRep=cir, SolarVector=amp_2, Plane=xy)  # -> Projection, Silhouette, Front
srf = Surface(cast_2.Projection)
preview = CustomPreview(Geometry=srf, Shader=col)

# ----
# Dibuja vector solar
# para ese espejo
vdis_2 = VectorDisplay(Anchor=move_3.Geometry, Vector=amp_2)

offset_2 = Offset(Curve=crv, Distance=offset_reflejo_b, Plane=canvas_borde, Corners=1)

# ----
# B
# ° Horas Alt
# ° Horas Az
panel_26 = Panel(deg_2)
panel_27 = Panel(deg)

# ----
# Conversión Worm Gear
# grados/rev de sinfin
# Steps/rev
# 1rev
panel_28 = Panel("360")
multiplication_9 = Multiplication(A=panel_28, B=panel_27)
multiplication_10 = Multiplication(A=panel_28, B=panel_26)
division_5 = Division(A=multiplication_10, B="2.25")
division_6 = Division(A=multiplication_9, B="2.25")
convert_to_steps = ConvertDegreesToSteps(Degrees=division_5, StepsPerRevolution="400", NumberOfMicrosteps=8)
convert_to_steps_2 = ConvertDegreesToSteps(Degrees=division_6, StepsPerRevolution="400", NumberOfMicrosteps=8)

# ----
# B
# Steps Alt
# Steps Az
panel_29 = Panel(convert_to_steps)
panel_30 = Panel(convert_to_steps_2)

eval_6 = EvaluateLength(Curve=ln, Length=panel_25, Normalized=True)  # -> Point, Tangent, Parameter

# ----
# Vector
# Reflejo(VR)
vec2pt_4 = Vector2Pt(PointA=pt_3, PointB=eval_6.Point, Unitize=False)  # -> Vector, Length

# ----
# Encuentra bisectriz entre
# VS y VR para normal
# Vector Normal
pl_10 = ConstructPlane(Origin=pt_3, XAxis=amp_2, YAxis=vec2pt_4.Vector)
angle_4 = Angle(VectorA=amp_2, VectorB=vec2pt_4.Vector, Plane=pl_10)  # -> Angle, Reflex
deplane_6 = DeconstructPlane(Plane=pl_10)  # -> Origin, XAxis, YAxis, ZAxis
division_7 = Division(A=angle_4.Angle, B=2)
vrot_4 = Rotate(Vector=amp_2, Axis=deplane_6.ZAxis, Angle=division_7)

# ----
# Calcula "brazo" de X
X_8 = UnitX(Factor=50)
Z_15 = UnitZ(Factor=1)
X_9 = UnitX(Factor=1)
Y_16 = UnitY(Factor=1)
pl_11 = ConstructPlane(Origin=pl_10, XAxis=X_8, YAxis=Z_15)
pl_12 = ConstructPlane(Origin=pl_10, XAxis=X_9, YAxis=Y_16)
deplane_7 = DeconstructPlane(Plane=pl_11)  # -> Origin, XAxis, YAxis, ZAxis
pl_13 = ConstructPlane(Origin=pl_10, XAxis=vrot_4, YAxis=deplane_7.YAxis)
ppx_2 = PlanePlane(PlaneA=pl_13, PlaneB=pl_12)
amp_10 = Amplitude(Vector=ppx_2, Amplitude="4")
pl_14 = PlaneNormal(Origin=deplane_6.Origin, ZAxis=amp_10)
move_4 = Move(Geometry=pl_14, Motion=amp_10)  # -> Geometry, Transform
ln_5 = Line(StartPoint=pl_10, EndPoint=move_4.Geometry)

# ----
# Calcula "brazo" de Y
amp_11 = Amplitude(Vector=vrot_4, Amplitude=panel_8)
pl_15 = PlaneNormal(Origin=move_4.Geometry, ZAxis=vrot_4)
move_5 = Move(Geometry=pl_15, Motion=amp_11)  # -> Geometry, Transform
ln_6 = Line(StartPoint=move_4.Geometry, EndPoint=move_5.Geometry)
# dibuja espejo
cir_2 = Circle(Plane=move_5.Geometry, Radius=division)
refl_2 = Reflector(Surface=cir_2, Point=move_5.Geometry, Vector=amp_2)
amp_12 = Amplitude(Vector=refl_2, Amplitude=-3000)

# ----
# Calcula Ángulo Azimuth
# Ángulo Azimuth
Z_16 = UnitZ(Factor=1)
rev_4 = Reverse(Vector=Z_16)
pl_16 = PlaneNormal(Origin=deplane_6.Origin, ZAxis=rev_4)
Y_17 = UnitY(Factor=1)
angle_5 = Angle(VectorA=Y_17, VectorB=ln_5, Plane=pl_16)  # -> Angle, Reflex
line_5 = LineSDL(Start=pl_16, Direction=Y_17, Length=number_slider_9)
rad_4 = Radians(Degrees=90)
arc_4 = Arc(Plane=pl_16, Radius=number_slider_9, Angle=angle_5.Angle)  # -> Arc, Length
rotate_2 = Rotate(Geometry=arc_4.Arc, Angle=rad_4, Plane=pl_16)  # -> Geometry, Transform
deg_3 = Degrees(Radians=angle_5.Angle)
arcdim_3 = ArcDimension(Arc=rotate_2.Geometry, Offset=2, Text="{0:0.0}°", Size=1)

# ----
# Calcula Ángulo Altitud
# Ángulo Altitud
deplane_8 = DeconstructPlane(Plane=move_4.Geometry)  # -> Origin, XAxis, YAxis, ZAxis
deplane_9 = DeconstructPlane(Plane=pl_15)  # -> Origin, XAxis, YAxis, ZAxis
pl_17 = ConstructPlane(Origin=move_4.Geometry, XAxis=deplane_8.ZAxis, YAxis=deplane_9.ZAxis)
line_6 = LineSDL(Start=move_4.Geometry, Direction=ln_5, Length=number_slider_9)
angle_6 = Angle(VectorA=amp_10, VectorB=deplane_9.ZAxis, Plane=pl_17)  # -> Angle, Reflex
arc_5 = Arc(Plane=pl_17, Radius=number_slider_9, Angle=angle_6.Angle)  # -> Arc, Length
deg_4 = Degrees(Radians=angle_6.Angle)
arcdim_4 = ArcDimension(Arc=arc_5.Arc, Offset=2, Text="{0:0.0}°", Size=1)

# ----
# Dibuja reflejo en pared
line_7 = LineSDL(Start=move_5.Geometry, Direction=amp_12, Length=5000)
plx_2 = LinePlane(Line=line_7, Plane=yz)  # -> Point, ParamL, ParamP
cast_3 = CastSilhouette(BRep=cir_2, SolarVector=amp_12, Plane=yz)  # -> Projection, Silhouette, Front
ln_7 = Line(StartPoint=move_5.Geometry, EndPoint=plx_2.Point)
crv_2 = Curve(cast_3.Silhouette)

# ----
# Proyecta sombra espejo
cast_4 = CastSilhouette(BRep=cir_2, SolarVector=amp_2, Plane=xy)  # -> Projection, Silhouette, Front
srf_2 = Surface(cast_4.Projection)
preview_2 = CustomPreview(Geometry=srf_2, Shader=col)

# ----
# Dibuja vector solar
# para ese espejo
vdis_3 = VectorDisplay(Anchor=move_5.Geometry, Vector=amp_3)

offset_3 = Offset(Curve=crv_2, Distance=offset_reflejo_a, Plane=canvas_borde, Corners=1)

# ----
# A
# ° Horas Alt
# ° Horas Az
panel_31 = Panel(deg_4)
panel_32 = Panel(deg_3)

# ----
# Conversión Worm Gear
# grados/rev de sinfin
# Steps/rev
# 1rev
panel_33 = Panel("-1")
# Invertir
multiplication_11 = Multiplication(A=panel_31, B=panel_33)
multiplication_12 = Multiplication(A="360", B=panel_32)
multiplication_13 = Multiplication(A="360", B=panel_31)
division_8 = Division(A=multiplication_13, B="2.25")
division_9 = Division(A=multiplication_12, B="2.25")
convert_to_steps_3 = ConvertDegreesToSteps(Degrees=division_8, StepsPerRevolution="400", NumberOfMicrosteps=8)
convert_to_steps_4 = ConvertDegreesToSteps(Degrees=division_9, StepsPerRevolution="400", NumberOfMicrosteps=8)

# ----
# Invertir
multiplication_14 = Multiplication(A=panel_32, B="-1")

# ----
# A
# Steps Alt
# Steps Az
panel_34 = Panel(convert_to_steps_3)
panel_35 = Panel(convert_to_steps_4)

eval_7 = EvaluateLength(Curve=bzspan.Curve, Length=panel_25, Normalized=True)  # -> Point, Tangent, Parameter

# ----
# Vector
# Reflejo(VR)
vec2pt_5 = Vector2Pt(PointA=pt_5, PointB=eval_7.Point, Unitize=False)  # -> Vector, Length

# ----
# Encuentra bisectriz entre
# VS y VR para normal
# Vector Normal
pl_18 = ConstructPlane(Origin=pt_5, XAxis=amp_2, YAxis=vec2pt_5.Vector)
angle_7 = Angle(VectorA=amp_2, VectorB=vec2pt_5.Vector, Plane=pl_18)  # -> Angle, Reflex
deplane_10 = DeconstructPlane(Plane=pl_18)  # -> Origin, XAxis, YAxis, ZAxis
division_10 = Division(A=angle_7.Angle, B=2)
vrot_5 = Rotate(Vector=amp_2, Axis=deplane_10.ZAxis, Angle=division_10)

# ----
# Calcula "brazo" de X
X_10 = UnitX(Factor=50)
Z_17 = UnitZ(Factor=1)
X_11 = UnitX(Factor=1)
Y_18 = UnitY(Factor=1)
pl_19 = ConstructPlane(Origin=pl_18, XAxis=X_10, YAxis=Z_17)
pl_20 = ConstructPlane(Origin=pl_18, XAxis=X_11, YAxis=Y_18)
deplane_11 = DeconstructPlane(Plane=pl_19)  # -> Origin, XAxis, YAxis, ZAxis
pl_21 = ConstructPlane(Origin=pl_18, XAxis=vrot_5, YAxis=deplane_11.YAxis)
ppx_3 = PlanePlane(PlaneA=pl_21, PlaneB=pl_20)
amp_13 = Amplitude(Vector=ppx_3, Amplitude="4")
pl_22 = PlaneNormal(Origin=deplane_10.Origin, ZAxis=amp_13)
move_6 = Move(Geometry=pl_22, Motion=amp_13)  # -> Geometry, Transform
ln_8 = Line(StartPoint=pl_18, EndPoint=move_6.Geometry)

# ----
# Calcula "brazo" de Y
amp_14 = Amplitude(Vector=vrot_5, Amplitude=panel_8)
pl_23 = PlaneNormal(Origin=move_6.Geometry, ZAxis=vrot_5)
move_7 = Move(Geometry=pl_23, Motion=amp_14)  # -> Geometry, Transform
ln_9 = Line(StartPoint=move_6.Geometry, EndPoint=move_7.Geometry)
# dibuja espejo
cir_3 = Circle(Plane=move_7.Geometry, Radius=division_3)
refl_3 = Reflector(Surface=cir_3, Point=move_7.Geometry, Vector=amp_2)
amp_15 = Amplitude(Vector=refl_3, Amplitude=-3000)

# ----
# Calcula Ángulo Azimuth
# Ángulo Azimuth
Z_18 = UnitZ(Factor=1)
rev_5 = Reverse(Vector=Z_18)
pl_24 = PlaneNormal(Origin=deplane_10.Origin, ZAxis=rev_5)
Y_19 = UnitY(Factor=1)
angle_8 = Angle(VectorA=Y_19, VectorB=ln_8, Plane=pl_24)  # -> Angle, Reflex
line_8 = LineSDL(Start=pl_24, Direction=Y_19, Length=number_slider_9)
rad_5 = Radians(Degrees=90)
arc_6 = Arc(Plane=pl_24, Radius=number_slider_9, Angle=angle_8.Angle)  # -> Arc, Length
rotate_3 = Rotate(Geometry=arc_6.Arc, Angle=rad_5, Plane=pl_24)  # -> Geometry, Transform
deg_5 = Degrees(Radians=angle_8.Angle)
arcdim_5 = ArcDimension(Arc=rotate_3.Geometry, Offset=2, Text="{0:0.0}°", Size=1)

# ----
# Calcula Ángulo Altitud
# Ángulo Altitud
deplane_12 = DeconstructPlane(Plane=move_6.Geometry)  # -> Origin, XAxis, YAxis, ZAxis
deplane_13 = DeconstructPlane(Plane=pl_23)  # -> Origin, XAxis, YAxis, ZAxis
pl_25 = ConstructPlane(Origin=move_6.Geometry, XAxis=deplane_12.ZAxis, YAxis=deplane_13.ZAxis)
line_9 = LineSDL(Start=move_6.Geometry, Direction=ln_8, Length=number_slider_9)
angle_9 = Angle(VectorA=amp_13, VectorB=deplane_13.ZAxis, Plane=pl_25)  # -> Angle, Reflex
arc_7 = Arc(Plane=pl_25, Radius=number_slider_9, Angle=angle_9.Angle)  # -> Arc, Length
deg_6 = Degrees(Radians=angle_9.Angle)
arcdim_6 = ArcDimension(Arc=arc_7.Arc, Offset=2, Text="{0:0.0}°", Size=1)

# ----
# Dibuja reflejo en pared
line_10 = LineSDL(Start=move_7.Geometry, Direction=amp_15, Length=5000)
plx_3 = LinePlane(Line=line_10, Plane=yz)  # -> Point, ParamL, ParamP
cast_5 = CastSilhouette(BRep=cir_3, SolarVector=amp_15, Plane=yz)  # -> Projection, Silhouette, Front
ln_10 = Line(StartPoint=move_7.Geometry, EndPoint=plx_3.Point)
crv_3 = Curve(cast_5.Silhouette)

# ----
# Proyecta sombra espejo
cast_6 = CastSilhouette(BRep=cir_3, SolarVector=amp_2, Plane=xy)  # -> Projection, Silhouette, Front
srf_3 = Surface(cast_6.Projection)
preview_3 = CustomPreview(Geometry=srf_3, Shader=col)

# ----
# Dibuja vector solar
# para ese espejo
vdis_4 = VectorDisplay(Anchor=move_7.Geometry, Vector=amp_2)

offset_4 = Offset(Curve=crv_3, Distance=offset_reflejo_c, Plane=canvas_borde, Corners=1)
crv_4 = Curve([ln, cat_10, bzspan.Curve, offset_3, offset_2, offset_4, canvas_borde, ln_7, ln_4, ln_10, cir_2, cir, cir_3])

# ----
# C
# ° Horas Alt
# ° Horas Az
panel_36 = Panel(deg_6)
panel_37 = Panel(deg_5)

# ----
# Conversión Worm Gear
# Invertir
# grados/rev de sinfin
# Steps/rev
# 1rev
# Invertir
panel_38 = Panel("-1")
multiplication_15 = Multiplication(A=panel_36, B=panel_38)
multiplication_16 = Multiplication(A=panel_37, B="-1")
multiplication_17 = Multiplication(A="360", B=panel_37)
multiplication_18 = Multiplication(A="360", B=panel_36)
division_11 = Division(A=multiplication_18, B="2.25")
division_12 = Division(A=multiplication_17, B="2.25")
convert_to_steps_5 = ConvertDegreesToSteps(Degrees=division_11, StepsPerRevolution="400", NumberOfMicrosteps=8)
convert_to_steps_6 = ConvertDegreesToSteps(Degrees=division_12, StepsPerRevolution="400", NumberOfMicrosteps=8)

# ----
# C
# Steps Alt
# Steps Az
panel_39 = Panel(convert_to_steps_5)
panel_40 = Panel(convert_to_steps_6)

zero = BooleanToggle(False)
addition_4 = Addition(A=Y_12, B=panel_34)
addition_5 = Addition(A=X_2, B=panel_35)
addition_6 = Addition(A=Y_11, B=panel_29)
addition_7 = Addition(A=X_3, B=panel_30)
addition_8 = Addition(A=Y_13, B=panel_39)
addition_9 = Addition(A=X_4, B=panel_40)
reset_3 = Reset(S=zero, int=addition_4)
reset_4 = Reset(S=zero, int=addition_5)
reset_5 = Reset(S=zero, int=addition_6)
reset_6 = Reset(S=zero, int=addition_7)
reset_7 = Reset(S=zero, int=addition_8)
reset_8 = Reset(S=zero, int=addition_9)
multiplication_19 = Multiplication(A=reset_4, B=-1)
multiplication_20 = Multiplication(A=reset_5, B=-1)
multiplication_21 = Multiplication(A=reset_7, B=-1)
multiplication_22 = Multiplication(A=reset_3, B=-1)
multiplication_23 = Multiplication(A=reset_6, B=-1)
multiplication_24 = Multiplication(A=reset_8, B=-1)
panel_41 = Panel(multiplication_22)
panel_42 = Panel(reset_4)
panel_43 = Panel(multiplication_20)
panel_44 = Panel(reset_6)
panel_45 = Panel(multiplication_21)
panel_46 = Panel(reset_8)
concat = Concatenate(
    FragmentA=panel_41,
    FragmentB=",",
    FragmentC=panel_42,
    FragmentD=",",
    FragmentE=panel_43,
    FragmentF=",",
    FragmentG=panel_44,
    FragmentH=",",
    FragmentI=panel_45,
    FragmentJ=",",
    FragmentK=panel_46,
    FragmentL="\n")  # -> flatten(Result)
panel_47 = Panel(concat)
choose_mega_port = Slider(1, range=0..1)
write_serial_to_mega = BooleanToggle(False)
open_mega_port = BooleanToggle(False)
panel_48 = Panel(ports_available)
port = ListItem(List=panel_48, Index=choose_mega_port, Wrap=True)
panel_49 = Panel(port)
timer_4 = Timer(TimerInterval=2000, Target=write)
open_port = OpenClosePort(OpenClosePort=open_mega_port, PortNumber=panel_49, BaudRate=9600)
write = SerialWriteGeneric(StartWritingValues=write_serial_to_mega, WriteData=panel_47, PortNumber=panel_49)  # -> ArduinoOutput, StatusMessage
panel_50 = Panel(write.ArduinoOutput)
panel_51 = Panel(write.StatusMessage)
panel_52 = Panel(open_port)

# ==== cluster Pt
T = ClusterInput()
V = ClusterInput()
T_2 = ClusterInput()
V_2 = ClusterInput()
remap = RemapNumbers(Value=V_2, Source=Domain(0, 1), Target=T)  # -> Mapped, Clipped
remap_2 = RemapNumbers(Value=V, Source=Domain(0, 1), Target=T_2)  # -> Mapped, Clipped
X = ClusterInput()
pt = ConstructPoint(XCoordinate=X, YCoordinate=remap.Mapped, ZCoordinate=remap_2.Mapped)
pt_2 = ClusterOutput(pt)

# ==== cluster Pt_2
V = ClusterInput()
T = ClusterInput()
V_2 = ClusterInput()
T_2 = ClusterInput()
remap = RemapNumbers(Value=V, Source=Domain(0, 1), Target=T)  # -> Mapped, Clipped
remap_2 = RemapNumbers(Value=V_2, Source=Domain(0, 1), Target=T_2)  # -> Mapped, Clipped
X = ClusterInput()
pt = ConstructPoint(XCoordinate=X, YCoordinate=remap.Mapped, ZCoordinate=remap_2.Mapped)
pt_2 = ClusterOutput(pt)

# ==== cluster Reset
int = ClusterInput()
int_2 = Integer(int)
S = ClusterInput()
log = DataLog(IncomingData=int_2, ResetLog=False, StartRecording=S, WrapValues=False, RecordingLength=0)
lng = ListLength(List=log)
subtraction = Subtraction(A=lng, B=1)
item = ListItem(List=log, Index=subtraction, Wrap=True)
subtraction_2 = Subtraction(A=item, B=int_2)
R = ClusterOutput(subtraction_2)
